# Grasshopper definition bim-lib-demo.gh (Grasshopper 1.0.8)

pipeline = GeometryPipeline(
    GroupByLayer=False,
    GroupByType=False,
    IncludeHidden=True,
    IncludeLocked=True,
    LayerFilter="louvers",
    NameFilter="*",
    SublayerFiltering=True,
    TypeFilter=4)
pipeline_2 = GeometryPipeline(
    GroupByLayer=False,
    GroupByType=False,
    IncludeHidden=True,
    IncludeLocked=True,
    LayerFilter="curtain facade",
    NameFilter="*",
    SublayerFiltering=True,
    TypeFilter=4)
pipeline_3 = GeometryPipeline(
    GroupByLayer=False,
    GroupByType=False,
    IncludeHidden=True,
    IncludeLocked=True,
    LayerFilter="columns",
    NameFilter="*",
    SublayerFiltering=True,
    TypeFilter=1)
pipeline_4 = GeometryPipeline(
    GroupByLayer=False,
    GroupByType=False,
    IncludeHidden=True,
    IncludeLocked=True,
    LayerFilter="floor plates",
    NameFilter="*",
    SublayerFiltering=True,
    TypeFilter=4)
py3 = Python3Script(
    boundary=pipeline_4,
    elevation_mm=Slider(0, range=0..100),
    finish_thickness_mm=Slider(20, range=0..100),
    screed_thickness_mm=Slider(50, range=0..100),
    insulation_thickness_mm=Slider(150, range=0..1000),
    structural_thickness_mm=Slider(250, range=0..1000))  # -> Brep_finish, Brep_screed, Brep_insulation, Brep_structural
# ---------- py3: Python ----------
import sys
import importlib

repo_src = r"C:\Users\mglui\Documents\GitHub\bim-lib-demo\src"
if repo_src not in sys.path:
    sys.path.append(repo_src)

from elements import floor_plate
importlib.reload(floor_plate)

layers = floor_plate.floor_plate(
    boundary=boundary,
    elevation_mm=elevation_mm,

    finish_thickness_mm=finish_thickness_mm,
    screed_thickness_mm=screed_thickness_mm,
    insulation_thickness_mm=insulation_thickness_mm,
    structural_thickness_mm=structural_thickness_mm
)

# Separate outputs (clean GH UX)
Brep_finish = layers["finish"]
Brep_screed = layers["screed"]
Brep_insulation = layers["insulation"]
Brep_structural = layers["structural"]
# ---------- end py3 ----------
py3_2 = Python3Script(
    guide=pipeline_2,
    mullion_spacing_mm=Slider(1200, range=0..10000),
    mullion_width_mm=Slider(51, range=0..100),
    mullion_depth_mm=Slider(110, range=0..1000),
    panel_thickness_mm=Slider(25, range=0..100),
    story_height_mm=Slider(3500, range=0..10000),
    stories=Slider(1, range=0..10),
    transom_height_mm=Slider(67, range=0..100),
    transom_depth_mm=Slider(110, range=0..1000),
    glass_inset_mm=Slider(42, range=0..100),
    glass_gap_mm=Slider(0, range=0..100))  # -> Brep_mullions, Brep_glass
# ---------- py3_2: Python ----------
import sys
import importlib

repo_src = r"C:\Users\mglui\Documents\GitHub\bim-lib-demo\src"
if repo_src not in sys.path:
    sys.path.append(repo_src)

from elements import curtain_wall
importlib.reload(curtain_wall)

Brep_mullions, Brep_glass = curtain_wall.curtain_wall(
    guide=guide,
    stories=stories,
    story_height_mm=story_height_mm,

    mullion_spacing_mm=mullion_spacing_mm,
    mullion_width_mm=mullion_width_mm,
    mullion_depth_mm=mullion_depth_mm,

    transom_height_mm=transom_height_mm,
    transom_depth_mm=transom_depth_mm,

    panel_thickness_mm=panel_thickness_mm,
    glass_inset_mm=glass_inset_mm,
    glass_gap_mm=glass_gap_mm
)
# ---------- end py3_2 ----------
py3_3 = Python3Script(
    base_point=pipeline_3,
    height_mm=Slider(3200, range=0..10000),
    shaft_radius_mm=Slider(250, range=0..1000),
    capital_radius_mm=Slider(800, range=0..1000),
    capital_height_mm=Slider(600, range=0..1000),
    slab_thickness_mm=Slider(150, range=0..1000),
    slab_radius_mm=Slider(800, range=0..1000),
    fillet_radius_mm=Slider(1000, range=0..1000))  # -> Brep_column
# ---------- py3_3: Python ----------
import sys
import importlib

repo_src = r"C:\Users\mglui\Documents\GitHub\bim-lib-demo\src"
if repo_src not in sys.path:
    sys.path.append(repo_src)

from elements import mushroom_column
importlib.reload(mushroom_column)

Brep_column = mushroom_column.mushroom_column(
    base_point=base_point,
    height_mm=height_mm,
    shaft_radius_mm=shaft_radius_mm,
    capital_radius_mm=capital_radius_mm,
    capital_height_mm=capital_height_mm,
    slab_thickness_mm=slab_thickness_mm,
    slab_radius_mm=slab_radius_mm,
    fillet_radius_mm=fillet_radius_mm
)
# ---------- end py3_3 ----------
py3_4 = Python3Script(
    guide=pipeline,
    spacing_mm=Slider(600, range=0..1000),
    depth_mm=Slider(419, range=0..1000),
    thickness_mm=Slider(41, range=0..100),
    height_mm=Slider(3450, range=0..10000),
    story_height_mm=Slider(3500, range=0..10000),
    stories=Slider(1, range=0..10),
    wave_amplitude_mm=Slider(236, range=0..1000),
    wave_frequency=Slider(5.5, range=0..10),
    twist_amplitude_rad=Slider(0, range=0..1),
    angle_fn=Slider(1, range=0..1))  # -> Brep_louvers
# ---------- py3_4: Python ----------
import sys
import importlib
import math

# --------------------------------------------------
# Add repo src to path
# --------------------------------------------------
repo_src = r"C:\Users\mglui\Documents\GitHub\bim-lib-demo\src"
if repo_src not in sys.path:
    sys.path.append(repo_src)

# --------------------------------------------------
# Import & reload element
# --------------------------------------------------
from elements import louvers
importlib.reload(louvers)

# --------------------------------------------------
# Design intent (facade behaviour)
# --------------------------------------------------
def angle_fn(t):
    # Smooth solar-like response along height
    return math.radians(30) * math.sin(t * math.pi)

# --------------------------------------------------
# Call repo element (returns SOLIDS)
# --------------------------------------------------
Brep_louvers = louvers.louvers(
    guide=guide,
    spacing_mm=spacing_mm,
    depth_mm=depth_mm,
    thickness_mm=thickness_mm,
    height_mm=height_mm,
    story_height_mm=story_height_mm,
    stories=stories,
    wave_amplitude_mm=wave_amplitude_mm,
    wave_frequency=wave_frequency,
    twist_amplitude_rad=twist_amplitude_rad,
    angle_fn=angle_fn
)
# ---------- end py3_4 ----------
entwine = Entwine(
    Branch00=py3.Brep_finish,
    Branch01=py3.Brep_screed,
    Branch02=py3.Brep_insulation,
    Branch03=py3.Brep_structural,
    FlattenInputs=True)
entwine_2 = Entwine(
    Branch00=ColourSwatch(SwatchColor=RGB(224, 209, 162)),
    Branch01=ColourSwatch(SwatchColor=RGB(209, 206, 186)),
    Branch02=ColourSwatch(SwatchColor=RGB(255, 255, 255)),
    Branch03=ColourSwatch(SwatchColor=RGB(171, 171, 171)),
    FlattenInputs=True)
entwine_3 = Entwine(Branch00=py3_4, Branch01=py3_2.Brep_mullions, Branch02=py3_2.Brep_glass, Branch03=py3_3, FlattenInputs=True)
entwine_4 = Entwine(
    Branch00=ColourSwatch(SwatchColor=RGB(207, 194, 120)),
    Branch01=ColourSwatch(SwatchColor=RGB(209, 206, 186)),
    Branch02=ColourSwatch(SwatchColor=RGBA(171, 171, 171, 54)),
    Branch03=ColourSwatch(SwatchColor=RGB(171, 171, 171)),
    FlattenInputs=True)
preview = CustomPreview(Geometry=entwine, Material=entwine_2)
preview_2 = CustomPreview(Geometry=entwine_3, Material=entwine_4)
